# Grasshopper definition 0.1_Rhino_Grasshopper_Python_Geometry.gh (Grasshopper 1.0.7)
# Copyright: Wickerson Studios
# plug-ins: Bifocals

yz_plane = YZPlane(Origin=Point(0, 0, 0))

# ----
# Geometry
# Open Grasshopper in Rhino Command Line
# Drag in GhPython Script node from Maths.Script
# Point
number_slider = Slider(10, range=0..10)
number_slider_2 = Slider(3, range=1..4)

ghpython_script = GhPythonScript(x=number_slider, y=number_slider_2, z=Slider(1, range=0..1))  # -> out, firstPoint_Output, secondPoint_Output; inputs x: Int32, y: Int32
# ---------- ghpython_script: Python ----------
"""
import rhinoscriptsyntax as rs


firstPoint = rs.AddPoint(x,y,z)
secondPoint = rs.AddPoint(x**2,y**3,z**4)

firstPoint_Output = firstPoint
secondPoint_Output = secondPoint
"""

import Rhino.Geometry as rg
import math

firstPoint = rg.Point3d(x,y,z)
secondPoint = rg.Point3d(math.sin(x),math.cos(y),z)

firstPoint_Output = firstPoint
secondPoint_Output = secondPoint
# ---------- end ghpython_script ----------
multiplication = Multiplication(A=number_slider, B=number_slider_2)
point = Point(ghpython_script.secondPoint_Output)
point_2 = Point(ghpython_script.firstPoint_Output)
line = Line(StartPoint=point_2, EndPoint=point)
range = Range(Domain=Domain(0, 1), Steps=multiplication)

graph_mapper = GraphMapper(
    range,
    x0=0,
    x1=1,
    y0=0,
    y1=1,
    Ox=0.4710144997,
    Oy=0.1101450324,
    Px=0.6623190045,
    Py=0.3594201207,
    container_name="Parabola")

end_points = EndPoints(Curve=line)  # -> Start, End
pipe_variable = PipeVariable(Curve=reparameterize(line), Parameters=range, Radii=graph_mapper, Caps="1")
sphere = Sphere(Base=[end_points.Start, end_points.End], Radius=number_slider_2)
solid_intersection = SolidIntersection(BrepsA=sphere, BrepsB=pipe_variable)
construct_domain = ConstructDomain(DomainStart=0, DomainEnd=Slider(0.98, range=0..2))
list_length = ListLength(List=solid_intersection)
range_2 = Range(Domain=construct_domain, Steps=list_length)
pi = Pi(Factor=range_2)
polar_array = PolarArray(Geometry=graft(solid_intersection), Plane=yz_plane, Count=number_slider, Angle=pi)  # -> Geometry, Transform
