# Grasshopper definition 0.1_Rhino_Grasshopper_Python_Geometry_Conditional.gh (Grasshopper 1.0.7)
# Copyright: Wickerson Studios
# plug-ins: Bifocals

number_slider = Slider(6, range=0..10)
# Drag in GhPython Script node from Maths.Script
number_slider_2 = Slider(1, range=0..10)

# ----
# Geometry
# Open Grasshopper in Rhino Command Line
panel = Panel("1")
construct_domain = ConstructDomain(DomainStart=panel, DomainEnd=number_slider)
range = Range(Domain=construct_domain, Steps=number_slider)
attrz = AttrZ(1)
ghpython_script = GhPythonScript(attrX=number_slider_2, attrY=range, attrZ=attrz, xyAmpl=Slider(4.405, range=0..10))  # -> out, points_Output; inputs attrX: Int32, attrY: Int32, attrZ: Int32
# ---------- ghpython_script: Python ----------
import Rhino.Geometry as rg
import math

points = []

for i in range(attrX,attrY, attrZ):
    if i < attrY:
        point = rg.Point3d(xyAmpl*(-i*attrX), xyAmpl*(attrY*i*math.sin(attrY)), math.exp(i*attrZ))
        point = rg.Point3d(xyAmpl*(-i*attrX), math.exp(i*attrZ), xyAmpl*(attrY*i*math.sin(attrY)))
        point = rg.Point3d(math.exp(i*attrZ), xyAmpl*(attrY*i*math.sin(attrY)), xyAmpl*(i*attrX))
        points.append(point)
    
    else:
        point = rg.Point3d(0,0,0)
        points.append(point)

points_Output = points
# ---------- end ghpython_script ----------
point = Point(simplify(ghpython_script.points_Output))
interpolate = Interpolate(Vertices=point, Degree=3, Periodic=False, KnotStyle=1)  # -> Curve, Length, Domain
clean_tree = CleanTree(RemoveNulls="1", RemoveInvalid="1", RemoveEmpty="1", Tree=interpolate.Curve)  # -> flatten(Tree)
panel_2 = Panel(clean_tree)
list_item = ListItem(List=clean_tree, Index=0, Wrap=True)  # -> Item, Item1, Item2, Item3, Item4, Item5, Item6
loft = Loft(
    Curves=[list_item.Item2, list_item.Item3],
    Options={Adjust=False, Closed=False, LoftEnds=0, LoftSimp=0, LoftType=0, Rebuild=10, Refit=0.01})
loft_2 = Loft(
    Curves=[list_item.Item3, list_item.Item4],
    Options={Adjust=False, Closed=False, LoftEnds=0, LoftSimp=0, LoftType=0, Rebuild=10, Refit=0.01})
loft_3 = Loft(
    Curves=[list_item.Item4, list_item.Item5],
    Options={Adjust=False, Closed=False, LoftEnds=0, LoftSimp=0, LoftType=0, Rebuild=10, Refit=0.01})
loft_4 = Loft(
    Curves=[list_item.Item5, list_item.Item6],
    Options={Adjust=False, Closed=False, LoftEnds=0, LoftSimp=0, LoftType=0, Rebuild=10, Refit=0.01})
loft_5 = Loft(
    Curves=[list_item.Item6, list_item.Item],
    Options={Adjust=False, Closed=False, LoftEnds=0, LoftSimp=0, LoftType=0, Rebuild=10, Refit=0.01})
loft_6 = Loft(
    Curves=[list_item.Item, list_item.Item1],
    Options={Adjust=False, Closed=False, LoftEnds=0, LoftSimp=0, LoftType=0, Rebuild=10, Refit=0.01})
loft_7 = Loft(
    Curves=[list_item.Item1, list_item.Item2],
    Options={Adjust=False, Closed=False, LoftEnds=0, LoftSimp=0, LoftType=0, Rebuild=10, Refit=0.01})
merge = Merge(Data1=loft_6, Data2=loft_7, Data3=loft, Data4=loft_2, Data5=loft_3, Data6=loft_4, Data7=loft_5)
list_length = ListLength(List=merge)
subtraction = Subtraction(A=list_length, B="1")
range_2 = Range(Domain=Slider(0.73, range=0..2), Steps=subtraction)
pi = Pi(Factor=range_2)
rotate_3d = Rotate3D(Geometry=merge, Angle=pi, Center=Point(0, 0, 0), Axis=Vector(0, 0, 1))  # -> Geometry, Transform
mirror = Mirror(Geometry=rotate_3d.Geometry, Plane=PlaneYZ(0, 0, 0))  # -> Geometry, Transform
merge_2 = Merge(Data1=rotate_3d.Geometry, Data2=mirror.Geometry)

number_slider_3 = Slider(42, range=0..100)  # disabled
surface = Surface(merge_2)  # disabled
number_slider_4 = Slider(0.486, range=0.001..2)  # disabled
divide_surface = DivideSurface(Surface=surface, UCount=number_slider_3, VCount=number_slider_3)  # -> Points, Normals, Parameters; disabled
amplitude = Amplitude(Vector=divide_surface.Normals, Amplitude=number_slider_4)  # disabled
vector_display = VectorDisplay(Anchor=divide_surface.Points, Vector=divide_surface.Normals)  # disabled
move = Move(Geometry=divide_surface.Points, Motion=amplitude)  # -> flatten(Geometry), Transform; disabled
expression = Expression(x=number_slider_3, Expression="x+1")  # disabled
surface_from_points = SurfaceFromPoints(Points=move.Geometry, UCount=expression, Interpolate=False)  # disabled
deconstruct_brep = DeconstructBrep(Brep=surface_from_points)  # -> Faces, graft(Edges), Vertices; disabled
deconstruct_brep_2 = DeconstructBrep(Brep=surface)  # -> Faces, graft(Edges), Vertices; disabled
loft_8 = Loft(
    Curves=[deconstruct_brep.Edges, deconstruct_brep_2.Edges],
    Options={Adjust=False, Closed=False, LoftEnds=0, LoftSimp=0, LoftType=0, Rebuild=10, Refit=0.01})  # -> flatten(Loft); disabled

merge_3 = Merge(Data1=surface_from_points, Data2=loft_8, Data3=surface)  # disabled

brep_join = BrepJoin(Breps=merge_3)  # -> Breps, Closed; disabled
