# Grasshopper definition 0.1_Rhino_Grasshopper_Python_Geometry_NestedLoops_004.gh (Grasshopper 1.0.7)
# Copyright: Wickerson Studios
# plug-ins: Bifocals

number_slider = Slider(10, range=0..10)
# Geometry
# Open Grasshopper in Rhino Command Line
# Drag in GhPython Script node from Maths.Script
number_slider_2 = Slider(1, range=1..10)
number_slider_3 = Slider(7, range=0..10)
number_slider_4 = Slider(4.93, range=0..10)
number_slider_5 = Slider(0.78, range=0..1)

number_slider_6 = Slider(4.405, range=0..10)  # disabled
number_slider_7 = Slider(1, range=0..10)  # disabled
number_slider_8 = Slider(6, range=0..10)  # disabled
number_slider_9 = Slider(0.73, range=0..2)  # disabled

panel = Panel("1")  # disabled
construct_domain = ConstructDomain(DomainStart=panel, DomainEnd=number_slider_8)  # disabled
ghpython_script = GhPythonScript(
    attrX=number_slider_2,
    attrY=number_slider_3,
    attrZ=Slider(3, range=0..10),
    attrU=Slider(1, range=1..10),
    attrV=number_slider,
    attrW=Slider(3, range=0..10),
    amp=number_slider_4)  # -> out, points_Output; inputs attrX: Int32, attrY: Int32, attrZ: Int32, attrU: Int32, attrV: Int32, attrW: Int32
# ---------- ghpython_script: Python ----------
import Rhino.Geometry as rg
import math

points = []

for i in range(attrX, attrY, attrZ):
    for j in range(attrU, attrV, attrW):
        point = rg.Point3d(math.acosh(i), math.asinh(j), amp)
        points.append(point)

points_Output = points
# ---------- end ghpython_script ----------
range = Range(Domain=construct_domain, Steps=number_slider_8)  # disabled
attrz = AttrZ(1)  # disabled
ghpython_script_2 = GhPythonScript(attrX=number_slider_7, attrY=range, attrZ=attrz, xyAmpl=number_slider_6)  # -> out, points_Output; inputs attrX: Int32, attrY: Int32, attrZ: Int32; disabled
# ---------- ghpython_script_2: Python ----------
import Rhino.Geometry as rg
import math

points = []

for i in range(attrX,attrY, attrZ):
    if i < attrY:
        point = rg.Point3d(xyAmpl*(-i*attrX), xyAmpl*(attrY*i*math.sin(attrY)), math.exp(i*attrZ))
        point = rg.Point3d(xyAmpl*(-i*attrX), math.exp(i*attrZ), xyAmpl*(attrY*i*math.sin(attrY)))
        point = rg.Point3d(math.exp(i*attrZ), xyAmpl*(attrY*i*math.sin(attrY)), xyAmpl*(i*attrX))
        points.append(point)
    
    else:
        point = rg.Point3d(0,0,0)
        points.append(point)

points_Output = points
# ---------- end ghpython_script_2 ----------
point = Point(ghpython_script.points_Output)
construct_domain_2 = ConstructDomain(DomainStart=0, DomainEnd=number_slider_4)
list_length = ListLength(List=point)
point_2 = Point(simplify(ghpython_script_2.points_Output))  # disabled
subtraction = Subtraction(A=list_length, B="1")
interpolate = Interpolate(Vertices=point_2, Degree=3, Periodic=False, KnotStyle=1)  # -> Curve, Length, Domain; disabled
range_2 = Range(Domain=construct_domain_2, Steps=subtraction)
panel_2 = Panel("1")  # disabled
clean_tree = CleanTree(RemoveNulls=panel_2, RemoveInvalid=panel_2, RemoveEmpty=panel_2, Tree=interpolate.Curve)  # -> flatten(Tree); disabled
unit_z = UnitZ(Factor=range_2)
panel_3 = Panel(clean_tree)  # disabled
jitter = Jitter(List=unit_z, Jitter=number_slider_5, Seed=number_slider_3)  # -> Values, Indices
jitter_2 = Jitter(List=unit_z, Jitter=number_slider_5, Seed=number_slider)  # -> Values, Indices
list_item = ListItem(List=clean_tree, Index=0, Wrap=True)  # -> Item, Item1, Item2, Item3, Item4, Item5, Item6; disabled
negative = Negative(Value=jitter_2.Values)
loft = Loft(
    Curves=[list_item.Item2, list_item.Item3],
    Options={Adjust=False, Closed=False, LoftEnds=0, LoftSimp=0, LoftType=0, Rebuild=10, Refit=0.01})  # disabled
loft_2 = Loft(
    Curves=[list_item.Item3, list_item.Item4],
    Options={Adjust=False, Closed=False, LoftEnds=0, LoftSimp=0, LoftType=0, Rebuild=10, Refit=0.01})  # disabled
loft_3 = Loft(
    Curves=[list_item.Item4, list_item.Item5],
    Options={Adjust=False, Closed=False, LoftEnds=0, LoftSimp=0, LoftType=0, Rebuild=10, Refit=0.01})  # disabled
loft_4 = Loft(
    Curves=[list_item.Item5, list_item.Item6],
    Options={Adjust=False, Closed=False, LoftEnds=0, LoftSimp=0, LoftType=0, Rebuild=10, Refit=0.01})  # disabled
loft_5 = Loft(
    Curves=[list_item.Item6, list_item.Item],
    Options={Adjust=False, Closed=False, LoftEnds=0, LoftSimp=0, LoftType=0, Rebuild=10, Refit=0.01})  # disabled
loft_6 = Loft(
    Curves=[list_item.Item, list_item.Item1],
    Options={Adjust=False, Closed=False, LoftEnds=0, LoftSimp=0, LoftType=0, Rebuild=10, Refit=0.01})  # disabled
loft_7 = Loft(
    Curves=[list_item.Item1, list_item.Item2],
    Options={Adjust=False, Closed=False, LoftEnds=0, LoftSimp=0, LoftType=0, Rebuild=10, Refit=0.01})  # disabled
move = Move(Geometry=point, Motion=negative)  # -> Geometry, Transform
move_2 = Move(Geometry=point, Motion=jitter.Values)  # -> Geometry, Transform
merge = Merge(Data1=loft_6, Data2=loft_7, Data3=loft, Data4=loft_2, Data5=loft_3, Data6=loft_4, Data7=loft_5)  # disabled
line = Line(StartPoint=move_2.Geometry, EndPoint=move.Geometry)
list_length_2 = ListLength(List=merge)  # disabled
range_3 = Range(Domain=Domain(0, 1), Steps=10)
panel_4 = Panel("1")  # disabled
subtraction_2 = Subtraction(A=list_length_2, B=panel_4)  # disabled
range_4 = Range(Domain=number_slider_9, Steps=subtraction_2)  # disabled
graph_mapper = GraphMapper(
    range_3,
    x0=0,
    x1=1,
    y0=0,
    y1=1,
    container_name="Sine",
    Equation_px=[0.0009907155763, 0.9907102585],
    Equation_py=[0.09802865982, 1])
pi = Pi(Factor=range_4)  # disabled
rotate_3d = Rotate3D(Geometry=merge, Angle=pi, Center=Point(0, 0, 0), Axis=Vector(0, 0, 1))  # -> Geometry, Transform; disabled
pipe_variable = PipeVariable(Curve=reparameterize(line), Parameters=range_3, Radii=graph_mapper, Caps="2")  # -> simplify(Pipe)
mirror = Mirror(Geometry=rotate_3d.Geometry, Plane=PlaneYZ(0, 0, 0))  # -> Geometry, Transform; disabled
solid_union = SolidUnion(Breps=flatten(pipe_variable))
merge_2 = Merge(Data1=rotate_3d.Geometry, Data2=mirror.Geometry)  # disabled

number_slider_10 = Slider(42, range=0..100)  # disabled
surface = Surface(merge_2)  # disabled
number_slider_11 = Slider(0.486, range=0.001..2)  # disabled
divide_surface = DivideSurface(Surface=surface, UCount=number_slider_10, VCount=number_slider_10)  # -> Points, Normals, Parameters; disabled
amplitude = Amplitude(Vector=divide_surface.Normals, Amplitude=number_slider_11)  # disabled
vector_display = VectorDisplay(Anchor=divide_surface.Points, Vector=divide_surface.Normals)  # disabled
move_3 = Move(Geometry=divide_surface.Points, Motion=amplitude)  # -> flatten(Geometry), Transform; disabled
expression = Expression(x=number_slider_10, Expression="x+1")  # disabled
surface_from_points = SurfaceFromPoints(Points=move_3.Geometry, UCount=expression, Interpolate=False)  # disabled
deconstruct_brep = DeconstructBrep(Brep=surface_from_points)  # -> Faces, graft(Edges), Vertices; disabled
deconstruct_brep_2 = DeconstructBrep(Brep=surface)  # -> Faces, graft(Edges), Vertices; disabled
loft_8 = Loft(
    Curves=[deconstruct_brep.Edges, deconstruct_brep_2.Edges],
    Options={Adjust=False, Closed=False, LoftEnds=0, LoftSimp=0, LoftType=0, Rebuild=10, Refit=0.01})  # -> flatten(Loft); disabled

merge_3 = Merge(Data1=surface_from_points, Data2=loft_8, Data3=surface)  # disabled

brep_join = BrepJoin(Breps=merge_3)  # -> Breps, Closed; disabled
