# Grasshopper definition 0.1_Rhino_Grasshopper_Python_Geometry_Nested_Conditionals_005.gh (Grasshopper 1.0.7)
# Copyright: Wickerson Studios
# plug-ins: Bifocals

number_slider = Slider(39, range=1..101)
# Geometry
# Open Grasshopper in Rhino Command Line
# Drag in GhPython Script node from Maths.Script
number_slider_2 = Slider(4, range=0..10)
number_slider_3 = Slider(1, range=0..1)

ghpython_script = GhPythonScript(stopA=number_slider_2, stopB=Slider(4, range=0..10), multi=number_slider)  # -> out, points1_Output, points2_Output, points3_Output; inputs stopA: Int32, stopB: Int32, multi: Int32
# ---------- ghpython_script: Python ----------
import Rhino.Geometry as rg
#import math

Grid1 = []
Grid2 = []
Grid3 = []

for x in range(0, multi, 1):
    for y in range(0, multi, 1):
        point = rg.Point3d(x,y,0)
        if x % stopA == 0 and y % stopB == 0:
            Grid1.append(point)
        elif x % stopA == 0 or y % stopB == 0:
            Grid2.append(point)
        else:
            Grid3.append(point)

points1_Output = Grid1
points2_Output = Grid2
points3_Output = Grid3
# ---------- end ghpython_script ----------
point = Point(ghpython_script.points1_Output)
point_2 = Point(ghpython_script.points2_Output)
point_3 = Point(ghpython_script.points3_Output)
deconstruct = Deconstruct(Point=point)  # -> XComponent, YComponent, ZComponent
move = Move(Geometry=point_2, Motion=Vector(0, 0, 10))  # -> Geometry, Transform
path_mapper = PathMapper(point_3, source="{A;B}(i)", target="{A;B}(floor(i/2))")
path_mapper_2 = PathMapper(point_3, source="{A;B}(i)", target="{A;B}(floor(i/3))")
path_mapper_3 = PathMapper(point_3, source="{A;B}(i)", target="{A;B}(i)")
sort_list = SortList(Keys=deconstruct.XComponent, ValuesA=deconstruct.YComponent)  # -> Keys, ValuesA
sort_list_2 = SortList(Keys=deconstruct.YComponent, ValuesValuesA=deconstruct.YComponent)  # -> Keys, ValuesValuesA
sort_list_3 = SortList(Keys=deconstruct.ZComponent, ValuesValuesA=deconstruct.YComponent)  # -> Keys, ValuesValuesA
line = Line(StartPoint=point_2, EndPoint=move.Geometry)
point_4 = Point(path_mapper_3)
point_5 = Point(path_mapper)
point_6 = Point(path_mapper_2)
construct_point = ConstructPoint(XCoordinate=sort_list_2.ValuesValuesA, YCoordinate=sort_list.ValuesA, ZCoordinate=sort_list_3.ValuesValuesA)
division = Division(A=number_slider, B="2")

surface_from_points = SurfaceFromPoints(Points=construct_point, UCount=division, Interpolate=False)
mesh_sphere = MeshSphere(Base=point_6, Radius=number_slider_3, UCount=10, VCount=20)
mesh_sphere_2 = MeshSphere(Base=point_4, Radius=number_slider_3, UCount=10, VCount=20)
mesh_sphere_3 = MeshSphere(Base=point_5, Radius=number_slider_3, UCount=10, VCount=20)
pipe = Pipe(Curve=line, Radius=Slider(0.49, range=0..1), Caps=2)

number_slider_4 = Slider(42, range=0..100)
surface = Surface(surface_from_points)
divide_surface = DivideSurface(Surface=surface, UCount=number_slider_4, VCount=number_slider_4)  # -> Points, Normals, Parameters
amplitude = Amplitude(Vector=divide_surface.Normals, Amplitude=Slider(0.981, range=0.001..2))
vector_display = VectorDisplay(Anchor=divide_surface.Points, Vector=divide_surface.Normals)
move_2 = Move(Geometry=divide_surface.Points, Motion=amplitude)  # -> flatten(Geometry), Transform
expression = Expression(x=number_slider_4, Expression="x+1")
surface_from_points_2 = SurfaceFromPoints(Points=move_2.Geometry, UCount=expression, Interpolate=False)
deconstruct_brep = DeconstructBrep(Brep=surface_from_points_2)  # -> Faces, graft(Edges), Vertices
deconstruct_brep_2 = DeconstructBrep(Brep=surface)  # -> Faces, graft(Edges), Vertices
loft = Loft(
    Curves=[deconstruct_brep.Edges, deconstruct_brep_2.Edges],
    Options={Adjust=False, Closed=False, LoftEnds=0, LoftSimp=0, LoftType=0, Rebuild=10, Refit=0.01})  # -> flatten(Loft)

merge = Merge(Data1=surface_from_points_2, Data2=loft, Data3=surface)

brep_join = BrepJoin(Breps=merge)  # -> Breps, Closed

dispatch = Dispatch(List=flatten(brep_join.Breps), DispatchPattern=[True, False])  # -> ListA, ListB
deconstruct_brep_3 = DeconstructBrep(Brep=dispatch.ListB)  # -> Faces, Edges, Vertices
deconstruct_brep_4 = DeconstructBrep(Brep=dispatch.ListA)  # -> Faces, Edges, Vertices
list_item = ListItem(List=deconstruct_brep_3.Edges, Index=0, Wrap=True)  # -> Item, Item1, Item2, Item3
list_item_2 = ListItem(List=deconstruct_brep_4.Edges, Index=0, Wrap=True)  # -> Item, Item1, Item2, Item3
loft_2 = Loft(
    Curves=[list_item_2.Item, list_item.Item],
    Options={Adjust=False, Closed=False, LoftEnds=0, LoftSimp=0, LoftType=0, Rebuild=10, Refit=0.01})
loft_3 = Loft(
    Curves=[list_item_2.Item3, list_item.Item3],
    Options={Adjust=False, Closed=False, LoftEnds=0, LoftSimp=0, LoftType=0, Rebuild=10, Refit=0.01})
loft_4 = Loft(
    Curves=[list_item_2.Item1, list_item.Item1],
    Options={Adjust=False, Closed=False, LoftEnds=0, LoftSimp=0, LoftType=0, Rebuild=10, Refit=0.01})
loft_5 = Loft(
    Curves=[list_item_2.Item2, list_item.Item2],
    Options={Adjust=False, Closed=False, LoftEnds=0, LoftSimp=0, LoftType=0, Rebuild=10, Refit=0.01})

merge_2 = Merge(Data1=deconstruct_brep_4.Faces, Data2=deconstruct_brep_3.Faces, Data3=loft_2, Data4=loft_4, Data5=loft_5, Data6=loft_3)
