# Grasshopper definition 0.1_Rhino_Grasshopper_Python_Geometry_Ramdom_006.gh (Grasshopper 1.0.7)
# Copyright: Wickerson Studios

# Geometry
# Open Grasshopper in Rhino Command Line
# Drag in GhPython Script node from Maths.Script
ghpython_script = GhPythonScript()  # -> out, wildPoint_Output
# ---------- ghpython_script: Python ----------
import Rhino.Geometry as rg
import random as r
import math

list = []

wild1 = r.random()
wild2 = r.randint(0,8)
wild3 = r.uniform(0,8)

for x in range(int(wild2 * wild3)):
    wildPoint = rg.Point3d(wild3 + math.sin(x / wild1), math.cos(x / wild2),x / wild3)
    list.append(wildPoint)

wildPoint_Output = list
# ---------- end ghpython_script ----------
interpolate = Interpolate(Vertices=ghpython_script.wildPoint_Output, Degree=3, Periodic=False, KnotStyle=1)  # -> Curve, Length, Domain
construct_point = ConstructPoint(XCoordinate=0, YCoordinate=0, ZCoordinate="1")
construct_point_2 = ConstructPoint(XCoordinate=0, YCoordinate=0, ZCoordinate=0)
line_sdl = LineSDL(Start=construct_point_2, Direction=construct_point, Length=1)
revolution = Revolution(Curve=interpolate.Curve, Axis=line_sdl, Domain=Domain(0, 6.283185307))
cap_holes = CapHoles(Brep=revolution)
