# Grasshopper definition 0.1_Rhino_Grasshopper_Python_TutorialVideo_001.gh (Grasshopper 1.0.7)
# Copyright: Wickerson Studios

# Interface
# Open Grasshopper in Rhino Command Line
# Drag in GhPython Script node from Maths.Script
ghpython_script = GhPythonScript()  # -> Out, A
# Edit the Inputs and Outputs
ghpython_script_2 = GhPythonScript()  # -> Out, BearCat
# Open the Python Script Editor
# Test Script or click OK
ghpython_script_3 = GhPythonScript()  # -> out, BearCat; unedited script template
# Change Data Access Types
# Change Type Hints
ghpython_script_4 = GhPythonScript()  # -> out, BearCat; inputs alpha: list, beta: tree of Boolean, gamma: Point3d; unedited script template
# Write some life affirming text in the
# python script editor by using
# triple quotes
ghpython_script_5 = GhPythonScript()  # -> out, BearCat; inputs alpha: list, beta: tree of Boolean, gamma: Point3d
# ---------- ghpython_script_5: Python ----------
import rhinoscriptsyntax as rs

"""
This is 
the happiest 
day of 
my life
"""
# ---------- end ghpython_script_5 ----------
# Zoom in and delete the inputs
# Play with some python operators and
# send them to Output (Out)
ghpython_script_6 = GhPythonScript()  # -> out, a
# ---------- ghpython_script_6: Python ----------
"""Provides a scripting component.
    Output:
        a: The a output variable"""

print 1+2-3*4/5**2%3//6
# ---------- end ghpython_script_6 ----------
panel = Panel(ghpython_script_6.out)
# Increment and Decrement
ghpython_script_7 = GhPythonScript()  # -> out, a, b
# ---------- ghpython_script_7: Python ----------
"""Provides a scripting component.
    Output:
        a: The a output variable
        b: The a output variable
"""

a = 10
b = 10

a += 2
b -= 2
# ---------- end ghpython_script_7 ----------
panel_2 = Panel(ghpython_script_7.a)
# Comparison and Logical Operators
# Decisions and Conditionals
panel_3 = Panel(ghpython_script_7.b)
number_slider = Slider(4, range=0..10)
number_slider_2 = Slider(2, range=0..10)
ghpython_script_8 = GhPythonScript(x=number_slider, y=number_slider_2)  # -> out, a; inputs x: Int32, y: Int32
# ---------- ghpython_script_8: Python ----------
if x == y:
    print "Equal"
else:
    print "Not equal"
# ---------- end ghpython_script_8 ----------
ghpython_script_9 = GhPythonScript(x=number_slider, y=number_slider_2)  # -> out, a; inputs x: Int32, y: Int32
# ---------- ghpython_script_9: Python ----------
if x > 0 and y > 0:
    print "x and y both have values greater than 0"
elif x > 0 or y > 0:
    print "Either x or y is not equal to 0"
else:
    print "x and y do not have values greater than 0"
# ---------- end ghpython_script_9 ----------
ghpython_script_10 = GhPythonScript(x=number_slider, y=number_slider_2)  # -> out, a; inputs x: Int32, y: Int32
# ---------- ghpython_script_10: Python ----------
if x != y:
    print "Not Equal"
else:
    print "Equal"
# ---------- end ghpython_script_10 ----------
ghpython_script_11 = GhPythonScript(x=number_slider, y=number_slider_2)  # -> out, a; inputs x: Int32, y: Int32
# ---------- ghpython_script_11: Python ----------
if x < y:
    print "Less Than"
else:
    print "Not Less Than"
# ---------- end ghpython_script_11 ----------
# Loops
number_slider_3 = Slider(4, range=0..10)
panel_4 = Panel(ghpython_script_9.out)
panel_5 = Panel(ghpython_script_8.out)
panel_6 = Panel(ghpython_script_10.out)
panel_7 = Panel(ghpython_script_11.out)
# Lists
# watch out for
# Type Hints and List Access
panel_8 = Panel("""1
9
7
NewYork
3
23
45
567
789
toco
cat
2.34
pi
sin(x)
BearCat""")
number_slider_4 = Slider(5, range=0..13)
number_slider_5 = Slider(3, range=0..10)
ghpython_script_12 = GhPythonScript(x=number_slider_3)  # -> out, a; inputs x: Int32
# ---------- ghpython_script_12: Python ----------
for i in range(x):
    print i
# ---------- end ghpython_script_12 ----------
ghpython_script_13 = GhPythonScript(start=Slider(3, range=0..10), stop=Slider(29, range=0..100), step=Slider(4, range=0..10))  # -> out, a; inputs start: Int32, stop: Int32, step: Int32
# ---------- ghpython_script_13: Python ----------
for i in range(start,stop,step):
    print i
# ---------- end ghpython_script_13 ----------
panel_9 = Panel(ghpython_script_12.out)
panel_10 = Panel(ghpython_script_13.out)
negative = Negative(Value=number_slider_4)
series = Series(Start=0, Step=1, Count=10)
series_2 = Series(Start=0, Step=Slider(2, range=0..10), Count=10)
series_3 = Series(Start=0, Step=1, Count=number_slider_5)
series_4 = Series(Start=0, Step=Slider(5, range=0..10), Count=number_slider_5)  # -> graft(Series)
# List Functions
ghpython_script_14 = GhPythonScript(x=panel_8, index=number_slider_4)  # -> out, a; inputs x: list, index: Int32
# ---------- ghpython_script_14: Python ----------
List = x

print List[index]
# ---------- end ghpython_script_14 ----------
ghpython_script_15 = GhPythonScript(x=panel_8, index=negative)  # -> out, a; inputs x: list, index: Int32; same code as ghpython_script_14
ghpython_script_16 = GhPythonScript(x=panel_8)  # -> out, a; inputs x: list
# ---------- ghpython_script_16: Python ----------
List = x

print len(List)

List.append(77)
print List[-1]

List.append("77")
print List[-1]
print type(List[-1])
# ---------- end ghpython_script_16 ----------
ghpython_script_17 = GhPythonScript(x=[series, series_2])  # -> out, a; inputs x: list of Int32
# ---------- ghpython_script_17: Python ----------
List = x

List.reverse()
print List

print max(List)
print min(List)

List.sort()
print List

List.insert(3,"string")
print List

List.append("Hot Toco")
print List

del List[3]
print List

del List[-1]
print List

print List.pop(8)
print List

ListTwo = List[2:17:3]
print ListTwo
# ---------- end ghpython_script_17 ----------
ghpython_script_18 = GhPythonScript(x=series_3, y=series_4)  # -> out, a; inputs x: list
# ---------- ghpython_script_18: Python ----------
xList = x
yList = y

xList.extend(yList)

print xList
# ---------- end ghpython_script_18 ----------
panel_11 = Panel(ghpython_script_14.out)
panel_12 = Panel(ghpython_script_15.out)
panel_13 = Panel(ghpython_script_16.out)
panel_14 = Panel(ghpython_script_17.out)
# List Functions
number_slider_6 = Slider(3, range=0..10)
# Errors and Debugging
number_slider_7 = Slider(5, range=0..10)
panel_15 = Panel(ghpython_script_18.out)
ghpython_script_19 = GhPythonScript(start=Slider(2, range=0..10), iteration=number_slider_7)  # -> out, a; inputs start: Int32, iteration: Int32
# ---------- ghpython_script_19: Python ----------
import rhinoscriptsyntax as rs

def LoopFunction(NUM,T):
    for i in range(1,T):
        NUM *= i
        print(NUM)
        

def main():
    
    num = start
    t = iteration
    
    LoopFunction(num,t)

main()

print ""

import rhinoscriptsyntax as rs

def LoopFunction(NUM,T):
    for i in range(1,T):
        NUM *= i
        print(NUM)
        

def main():
    
    num = start
    t = iteration
    
    LoopFunction(num,t)

main()
# ---------- end ghpython_script_19 ----------
ghpython_script_20 = GhPythonScript(x=number_slider_6, y=Slider(3, range=0..10))  # -> out, a
# ---------- ghpython_script_20: Python ----------
import rhinoscriptsyntax as rs

def RectArea(length,width):
    area = length * width
    return area

print RectArea(x,y)


"""

import Rhino.Geometry as rg

def RectArea(length,width):
    area = length * width
    return area

print RectArea(x,y)

"""
# ---------- end ghpython_script_20 ----------
panel_16 = Panel(ghpython_script_20.out)
panel_17 = Panel(ghpython_script_19.out)
